# Grasshopper definition ul_Activities_time2.gh (Grasshopper 1.0.7)
# plug-ins: MeerkatGIS, EleFront, Human

path = FilePath("C:\Loc2Route\230601_routes\20230601_134913_finalDataRoute_Route_coffee_walking.json")
path_2 = FilePath("C:\Loc2Route\230525_locations\20230525_135710_locations_Coffee_150m.json")
file = ReadFile(PerLineParse=True)  # -> C
#   port F: Uri of file to read
# ---------- file: VB line parser ----------
    action = GH_LineParserAction.Include
    Return line

    'Parse the line and return some data that represents the line.
    'If the line cannot be parsed, you can return Nothing and
    'assign a different action.
    'The default implementation is to just return the line itself.
    'If you return types that implement IGH_Goo, this component
    'will work substantially faster.
# ---------- end file ----------
path_3 = FilePath("C:\Users\evallina\Dropbox\_eMiniProjects\210124_eRoutes\_urbanlensesRepos\urbanlenses\ul_GSP\_meerkat\bldg_outlines2.mkgis")
python = GhPythonScript()  # inputs on: Boolean
# ---------- python: Python ----------
__author__ = "evallina"
__version__ = "2023.05.31"

import rhinoscriptsyntax as rs

import json
import Grasshopper.Kernel as ghk
import Grasshopper.Kernel.Parameters as ghParams
import Grasshopper.Kernel.Data as ghData
import Grasshopper as gh
import scriptcontext as sc

# Read the JSON file
def read_json_file(file_path):
    with open(file_path, 'r') as json_file:
        data = json.load(json_file)
    return data

# Create Outputs
def collect_data(data, output_dict, path = []):
    for key, value in data.items():
        new_path = list(path)
        new_path.append(key)
        if isinstance(value, dict):
            collect_data(value, output_dict, new_path)
        elif isinstance(value, list):
            for index, item in enumerate(value):
                if isinstance(item, dict):
                    collect_data(item, output_dict, new_path + [str(index)])
        else:
            output_name = '_'.join(new_path)
            if output_name not in output_dict:
                output_dict[output_name] = []
            output_dict[output_name].append(value)

def create_outputs(output_dict):
    for output_name, values in output_dict.items():
        output_index = ghenv.Component.Params.Output.Count
        p = ghParams.Param_GenericObject()
        p.Name = output_name
        p.NickName = output_name
        p.Description = output_name
        p.Access = ghk.GH_ParamAccess.list
        ghenv.Component.Params.RegisterOutputParam(p)
        ghenv.Component.Params.OnParametersChanged()
        ghenv.Component.Attributes.PerformLayout()
        ghenv.Component.OnPingDocument().ScheduleSolution(1, lambda: ghenv.Component.ExpireSolution(False))
        for i, value in enumerate(values):
            ghenv.Component.Params.Output[output_index].AddVolatileData(ghData.GH_Path(0), i, value)

# Erase Outputs
def erase_outputs():
    for i in range(ghenv.Component.Params.Output.Count-1, -1, -1):
        ghenv.Component.Params.UnregisterOutputParameter(ghenv.Component.Params.Output[i])
    ghenv.Component.Params.OnParametersChanged()
    ghenv.Component.Attributes.PerformLayout()

# Use the functions
if on:
    data = read_json_file(locFile)
    output_dict = {}
    for entry in data.values():
        collect_data(entry, output_dict)
    create_outputs(output_dict)
else:
    erase_outputs()
# ---------- end python ----------
path_4 = FilePath("C:\Loc2Route\230601_locations\20230601_134913_locations_coffee_150m.json")
parse_mkgis = ParseMeerkatFile(MeerkatFile=path_3)  # -> DateCropped, UserAndMachineNamed, PathForFiles, ShapeType, ShapeCountInSource, BoundsInPointSpace, BoundsInLatLong, FieldNames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
python_2 = GhPythonScript(x=path_2)  # -> out, a, simplify(b)
# ---------- python_2: Python ----------
__author__ = "evallina"
__version__ = "2023.05.25"

import rhinoscriptsyntax as rs


import json
import Rhino
import ghpythonlib.treehelpers as th

# Read the JSON data
with open(x, 'r') as file:  # 'x' corresponds to the file path input
    data = json.load(file)

keys = []
values = {}

# Get the first data entry keys
first_entry = next(iter(data.values()))
keys = list(first_entry.keys())

# Initialize values with empty lists for each key
for key in keys:
    values[key] = []

# Iterate over the items in the data
for _, value in data.items():
    for sub_key, sub_value in value.items():
        values[sub_key].append(sub_value)

# Convert values to a data tree, with each branch corresponding to a key
b = th.list_to_tree(list(values.values()))

# Output the keys and values
a = keys
# ---------- end python_2 ----------
givethatjson = GhPythonScript(locFile=path_4, on=Toggle(True))  # -> address, hours_close_hours, hours_opening_days, hours_start_hours, hours_time_window, icon, lat, lng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; inputs on: Boolean
#   port hours_close_hours: hours_close_hours
#   port hours_opening_days: hours_opening_days
#   port hours_start_hours: hours_start_hours
#   port hours_time_window: hours_time_window
# ---------- givethatjson: Python ----------
__author__ = "evallina"
__version__ = "2023.05.31"

import rhinoscriptsyntax as rs
import json
import Grasshopper.Kernel as ghk
import Grasshopper.Kernel.Parameters as ghParams
import Grasshopper.Kernel.Data as ghData
import Grasshopper as gh
import scriptcontext as sc

# Read the JSON file
def read_json_file(file_path):
    with open(file_path, 'r') as json_file:
        data = json.load(json_file)
    return data

# Create Outputs
def collect_data(data, output_dict, path = []):
    for key, value in data.items():
        new_path = list(path)
        new_path.append(key)
        if isinstance(value, dict):
            collect_data(value, output_dict, new_path)
        elif isinstance(value, list):
            output_name = '_'.join(new_path)
            if output_name not in output_dict:
                output_dict[output_name] = []
            output_dict[output_name].append(value)
        else:
            output_name = '_'.join(new_path)
            if output_name not in output_dict:
                output_dict[output_name] = []
            output_dict[output_name].append(value)

def create_outputs(output_dict):
    for output_name in sorted(output_dict.keys()):
        values = output_dict[output_name]
        output_index = ghenv.Component.Params.Output.Count
        p = ghParams.Param_GenericObject()
        p.Name = output_name
        p.NickName = output_name
        p.Description = output_name
        p.Access = ghk.GH_ParamAccess.tree
        ghenv.Component.Params.RegisterOutputParam(p)
        ghenv.Component.Params.OnParametersChanged()
        ghenv.Component.Attributes.PerformLayout()
        ghenv.Component.OnPingDocument().ScheduleSolution(1, lambda: ghenv.Component.ExpireSolution(False))
        for i, value in enumerate(values):
            path = ghData.GH_Path(i)
            if isinstance(value, list):
                for j, sub_value in enumerate(value):
                    ghenv.Component.Params.Output[output_index].AddVolatileData(path, j, sub_value)
            else:
                ghenv.Component.Params.Output[output_index].AddVolatileData(path, 0, value)

# Erase Outputs
def erase_outputs():
    for i in range(ghenv.Component.Params.Output.Count-1, -1, -1):
        ghenv.Component.Params.UnregisterOutputParameter(ghenv.Component.Params.Output[i])
    ghenv.Component.Params.OnParametersChanged()
    ghenv.Component.Attributes.PerformLayout()

# Use the functions
if on:
    data = read_json_file(locFile)
    output_dict = {}
    for entry in data.values():
        collect_data(entry, output_dict)
    create_outputs(output_dict)
else:
    erase_outputs()
# ---------- end givethatjson ----------
panel = Panel(python_2.a)
geometry_per_shape = EFDataDescription(parse_mkgis.GeometryPerShape)
area = Area(Geometry=parse_mkgis.BoundsInPointSpace)  # -> Area, Centroid
hours_opening_days = EFDataDescription(givethatjson.hours_opening_days)
hours_time_window = EFDataDescription(givethatjson.hours_time_window)
hours_close_hours = EFDataDescription(givethatjson.hours_close_hours)
hours_start_hours = EFDataDescription(givethatjson.hours_start_hours)
vec2pt = Vector2Pt(PointA=area.Centroid, PointB=Point(0, 0, 0), Unitize=False)  # -> Vector, Length
hours_time_window_2 = EFDataDescription(givethatjson.hours_time_window)
lat = EFDataDescription(givethatjson.lat)
lng = EFDataDescription(givethatjson.lng)
path_5 = FilePath("C:\Users\evallina\Dropbox\_eMiniProjects\210124_eRoutes\_urbanlensesRepos\urbanlenses\ul_GSP\_meerkat\Building_Outlines_2015.prj")
panel_2 = Panel(hours_start_hours)
move = Move(Motion=vec2pt.Vector)  # -> Geometry, Transform
transform = Transform(move.Transform)
transform_2 = Transform(Geometry=geometry_per_shape, Transform=transform)
lat_long_to_point = LatLongToPoint(Latitude=lat, Longitude=lng, ProjectionFile=path_5)
pline = PolyLine(Vertices=transform_2, Closed=True)
lat_long_to_point_2 = LatLongToPoint()
transform_3 = Transform(move.Transform)
geo = Geometry(pline)
transform_4 = Transform(Geometry=lat_long_to_point, Transform=transform_3)
places_locations = EFDataDescription(transform_4)
previewlw = CustomPreviewLineweights(Geometry=geo, Shader=ColourSwatch(SwatchColor=RGB(0, 28, 54)), Absolute=False)
time_of_the_day = Slider(11, range=0..23)
day_of_the_week = ValueList({"Sunday": 0, "Monday": 1, "Tuesday": 2, "Wednesday": 3, "Thursday": 4, "Friday": 5, "Saturday": 6}, selected="Tuesday")
day_of_the_week_2 = EFDataDescription(day_of_the_week)
time_of_the_day_2 = EFDataDescription(time_of_the_day)
places_locations_2 = EFDataDescription(places_locations)
hours_opening_days_2 = EFDataDescription(hours_opening_days)
day_of_the_week_3 = EFDataDescription(day_of_the_week_2)
python_3 = GhPythonScript(day=day_of_the_week_2, time=time_of_the_day_2)  # -> out, dayText, timeText; inputs day: Int32, time: Int32
# ---------- python_3: Python ----------
__author__ = "evallina"
__version__ = "2023.06.01"

import rhinoscriptsyntax as rs

import datetime

# Define the input parameters
day = int(day)
time = int(time)

# Convert the day integer to day name
day_names = [ 'Sunday', 'Monday', 'Tuesday', 'Wednesday', 'Thursday', 'Friday', 'Saturday']
dayText = day_names[day]

# Format the time as "hh:mm"
timeText = datetime.time(time).strftime("%H:%M")

# Output the results
dayText, timeText
# ---------- end python_3 ----------
places_locations_3 = EFDataDescription(places_locations)
places_locations_4 = EFDataDescription(flatten(places_locations_3))
item = ListItem(List=hours_opening_days_2, Index=day_of_the_week_3, Wrap=True)
panel_3 = Panel(item)
pt = ConstructPoint(XCoordinate=Slider(22, range=0..300), YCoordinate=Slider(46, range=0..300), ZCoordinate=0)
pt_2 = ConstructPoint(XCoordinate=Slider(22, range=0..300), YCoordinate=Slider(66, range=0..300), ZCoordinate=0)
cornersarea = GhPythonScript(x=places_locations_4)  # -> out, a; inputs x: list of Point3d
# ---------- cornersarea: Python ----------
__author__ = "evallina"
__version__ = "2023.06.01"

import rhinoscriptsyntax as rs
import Rhino.Geometry as rg

# Check if the input list is not empty
if x:
    # Get the minimum and maximum points based on x and y coordinates
    min_point = rg.Point3d(min(x, key=lambda point: point.X).X, max(x, key=lambda point: point.Y).Y, 0)
    max_point = rg.Point3d(max(x, key=lambda point: point.X).X, min(x, key=lambda point: point.Y).Y, 0)
else:
    # If the input list is empty, set the default points
    min_point = rg.Point3d(0, 0, 0)
    max_point = rg.Point3d(0, 0, 0)

# Output the minimum and maximum points
a=[max_point, min_point ]
# ---------- end cornersarea ----------
dispatch = Dispatch(List=places_locations_2, DispatchPattern=item)  # -> ListA, ListB
hours_time_window_3 = EFDataDescription(hours_time_window)
item_2 = ListItem(List=cornersarea.a, Index=0, Wrap=True)  # -> Item, Item1
hours_close_hours_2 = EFDataDescription(hours_close_hours)
places_locations_5 = EFDataDescription(places_locations)
hours_start_hours_2 = EFDataDescription(hours_start_hours)
places_locations_6 = EFDataDescription(places_locations)
texttoscreen = RenderTextToScreen(Text=python_3.dayText, Location=pt, Size=20, Color=RGB(255, 255, 255), Font="Arial", m_scWithvp=False)
texttoscreen_2 = RenderTextToScreen(Text=python_3.timeText, Location=pt_2, Size=10, Color=RGB(255, 255, 255), Font="Arial", m_scWithvp=False)
sel_locations = EFDataDescription(dispatch.ListA)
cir = Circle(Plane=sel_locations, Radius=20)
rec_2pt = Rectangle2Pt(Plane=PlaneXY(0, 0, 0), PointA=item_2.Item, PointB=item_2.Item1, Radius=0)  # -> Rectangle, Length
number_slider = Slider(16, range=10..60)
item_3 = ListItem(List=hours_start_hours_2, Index=day_of_the_week_3, Wrap=True)
item_4 = ListItem(List=hours_close_hours_2, Index=day_of_the_week_3, Wrap=True)
item_5 = ListItem(List=hours_time_window_3, Index=day_of_the_week_3, Wrap=True)
offset = OffsetCurve(Curve=rec_2pt.Rectangle, Distance=1000, Corners=1)
srf = Surface(cir)
time_of_the_day_3 = EFDataDescription(time_of_the_day_2)
sel_time_window = EFDataDescription(item_5)
places_locations_7 = EFDataDescription(places_locations_5)
sel_open_hours = EFDataDescription(item_3)
sel_close_hours = EFDataDescription(item_4)
sel_locations_2 = EFDataDescription(sel_locations)
preview = CustomPreview(Geometry=srf, Material=ColourSwatch(SwatchColor=RGB(255, 208, 0)))
sdivide = DivideSurface(Surface=offset, UCount=number_slider, VCount=number_slider)  # -> Points, Normals, Parameters
dom = ConstructDomain(DomainStart=0, DomainEnd=24)
dom_2 = ConstructDomain(DomainStart=Slider(50, range=50..250), DomainEnd=Slider(309, range=50..450))
points_grid = EFDataDescription(sdivide.Points)
python_4 = GhPythonScript(open_time=sel_open_hours, close_time=sel_close_hours)  # -> out, a; inputs open_time: Int32, close_time: Int32
# ---------- python_4: Python ----------
__author__ = "evallina"
__version__ = "2023.06.01"

import rhinoscriptsyntax as rs

dayTimesList=[]

for i in range(23):
    if open_time<= i <=close_time:
        dayTimesList.append(True)
    else:
        dayTimesList.append(False)
        
a=dayTimesList
# ---------- end python_4 ----------
places_locations_8 = EFDataDescription(places_locations_6)
remap = RemapNumbers(Value=sel_time_window, Source=dom, Target=dom_2)  # -> Mapped, Clipped
time_of_the_day_4 = EFDataDescription(time_of_the_day_3)
item_6 = ListItem(List=python_4.a, Index=time_of_the_day_4, Wrap=True)  # -> simplify(Item)
cir_2 = Circle(Plane=places_locations_8, Radius=remap.Mapped)
panel_4 = Panel("""30
15""")
panel_5 = Panel(sel_open_hours)
dispatch_2 = Dispatch(List=sel_locations_2, DispatchPattern=item_6)  # -> ListA, ListB
panel_6 = Panel(sel_close_hours)
dash = DashPattern(Curve=cir_2, Pattern=panel_4)  # -> Dashes, Gaps
places_opened = EFDataDescription(dispatch_2.ListA)
panel_7 = Panel(sel_time_window)
panel_8 = Panel(item_6)
previewlw_2 = CustomPreviewLineweights(Geometry=dash.Dashes, Shader=ColourSwatch(SwatchColor=RGB(0, 191, 255)), Absolute=False)
cir_3 = Circle(Plane=places_opened, Radius=remap.Mapped)
srf_2 = Surface(cir_3)
number_slider_2 = Slider(0.69, range=0..5)
places_opened_2 = EFDataDescription(flatten(places_opened))
points_grid_2 = EFDataDescription(flatten(points_grid))
preview_2 = CustomPreview(Geometry=srf_2, Material=ColourSwatch(SwatchColor=RGB(129, 140, 0)))

# ---- group: Influence Points (smooth Gradient)
cps = ClosestPoints(Point=places_opened_2, Cloud=points_grid_2, Count=6)  # -> flatten(ClosestPoint), CPIndex, Distance
cullpt = CullDuplicates(Points=cps.ClosestPoint, Tolerance=0.1, CullMode=3)  # -> Points, Indices, Valence

# ----
vec = VectorXYZ(XComponent=number_slider_2, YComponent=number_slider_2, ZComponent=0)  # -> Vector, Length
Y = UnitY(Factor=1)
move_2 = Move(Geometry=cullpt.Points, Motion=vec.Vector)  # -> Geometry, Transform
lng_2 = ListLength(List=cullpt.Points)
lng_3 = ListLength(List=points_grid_2)
lng_4 = ListLength(List=places_opened_2)
dup = DuplicateData(Data=50, Number=lng_2, Order=True)
dup_2 = DuplicateData(Data=0, Number=lng_3, Order=True)
dup_3 = DuplicateData(Data=100, Number=lng_4, Order=True)
entwine = Entwine(Branch00=places_opened_2, Branch01=points_grid_2, Branch02=move_2.Geometry, FlattenInputs=True)  # -> flatten(Result)
entwine_2 = Entwine(Branch00=dup_3, Branch01=dup_2, Branch02=dup, FlattenInputs=True)  # -> flatten(Result)
con = DelaunayEdges(Points=entwine, Plane=PlaneXY(0, 0, 0))  # -> Connectivity, Edges
del = DelaunayMesh(Points=entwine, Plane=PlaneXY(0, 0, 0))
bnd = Bounds(Numbers=entwine_2)
dedomain = DeconstructDomain(Domain=bnd)  # -> Start, End
cloud = CloudDisplay(Colours=RGB(255, 20, 147), Size=1, SpriteType=0)
gradient = Gradient(
    LowerLimit=dedomain.Start,
    UpperLimit=dedomain.End,
    Parameter=entwine_2,
    stops=[0.459: RGB(0, 37, 61), 0.542: RGB(220, 0, 40)])
mcol = MeshColours(Mesh=del, Colours=gradient)
mblur = BlurMesh(Mesh=mcol, Iterations=Slider(6, range=1..20))
