# Grasshopper definition ul_Activities_time4.gh (Grasshopper 1.0.7)
# plug-ins: MeerkatGIS, EleFront, Human

path = FilePath("C:\Loc2Route\230601_routes\20230601_134913_finalDataRoute_Route_coffee_walking.json")

# ---- group: DRAW A SIMPLE MAP
path_2 = FilePath("C:\Users\evallina\Dropbox\_eMiniProjects\210124_eRoutes\_urbanlensesRepos\urbanlenses\ul_GSP\_meerkat\bldg_outlines2.mkgis")
parse_mkgis = ParseMeerkatFile(MeerkatFile=path_2)  # -> DateCropped, UserAndMachineNamed, PathForFiles, ShapeType, ShapeCountInSource, BoundsInPointSpace, BoundsInLatLong, FieldNames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
geometry_per_shape = EFDataDescription(parse_mkgis.GeometryPerShape)
area = Area(Geometry=parse_mkgis.BoundsInPointSpace)  # -> Area, Centroid
vec2pt = Vector2Pt(PointA=area.Centroid, PointB=Point(0, 0, 0), Unitize=False)  # -> Vector, Length
move = Move(Motion=vec2pt.Vector)  # -> Geometry, Transform
transform = Transform(move.Transform)
transform_2 = Transform(Geometry=geometry_per_shape, Transform=transform)
pline = PolyLine(Vertices=transform_2, Closed=True)
geo = Geometry(pline)
previewlw = CustomPreviewLineweights(Geometry=geo, Shader=ColourSwatch(SwatchColor=RGB(0, 74, 143)), Absolute=False)

# ---- group: JSON INPUT
path_3 = FilePath("C:\Loc2Route\230601_locations\20230601_134913_locations_coffee_150m.json")
givemethatjson_please = GhPythonScript(locFile=path_3, on=Toggle(True))  # -> address, hours_close_hours, hours_opening_days, hours_start_hours, hours_time_window, icon, lat, lng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; inputs on: Boolean
#   port hours_close_hours: hours_close_hours
#   port hours_opening_days: hours_opening_days
#   port hours_start_hours: hours_start_hours
#   port hours_time_window: hours_time_window
# ---------- givemethatjson_please: Python ----------
__author__ = "evallina"
__version__ = "2023.05.31"

import rhinoscriptsyntax as rs
import json
import Grasshopper.Kernel as ghk
import Grasshopper.Kernel.Parameters as ghParams
import Grasshopper.Kernel.Data as ghData
import Grasshopper as gh
import scriptcontext as sc

# Read the JSON file
def read_json_file(file_path):
    with open(file_path, 'r') as json_file:
        data = json.load(json_file)
    return data

# Create Outputs
def collect_data(data, output_dict, path = []):
    for key, value in data.items():
        new_path = list(path)
        new_path.append(key)
        if isinstance(value, dict):
            collect_data(value, output_dict, new_path)
        elif isinstance(value, list):
            output_name = '_'.join(new_path)
            if output_name not in output_dict:
                output_dict[output_name] = []
            output_dict[output_name].append(value)
        else:
            output_name = '_'.join(new_path)
            if output_name not in output_dict:
                output_dict[output_name] = []
            output_dict[output_name].append(value)
            
            
def create_outputs(output_dict):
    output_list = []  # Step 1
    for output_name in sorted(output_dict.keys()):
        values = output_dict[output_name]
        output_index = ghenv.Component.Params.Output.Count
        p = ghParams.Param_GenericObject()
        p.Name = output_name
        p.NickName = output_name
        
        p.Description = output_name
        p.Access = ghk.GH_ParamAccess.tree
        ghenv.Component.Params.RegisterOutputParam(p)
        ghenv.Component.Params.OnParametersChanged()
        ghenv.Component.Attributes.PerformLayout()
        ghenv.Component.OnPingDocument().ScheduleSolution(1, lambda: ghenv.Component.ExpireSolution(False))
        
        output_list.append(output_name)  # Step 2

        for i, value in enumerate(values):
            path = ghData.GH_Path(i)
            if isinstance(value, list):
                for j, sub_value in enumerate(value):
                    ghenv.Component.Params.Output[output_index].AddVolatileData(path, j, sub_value)
            else:
                ghenv.Component.Params.Output[output_index].AddVolatileData(path, 0, value)

    # Step 3
    output_index = ghenv.Component.Params.Output.Count
    p = ghParams.Param_GenericObject()
    p.Name = 'Output_Names'
    p.NickName = 'Output_Names'
    p.Description = 'List of generated outputs'
    p.Access = ghk.GH_ParamAccess.list
    ghenv.Component.Params.RegisterOutputParam(p)
    ghenv.Component.Params.OnParametersChanged()
    ghenv.Component.Attributes.PerformLayout()
    ghenv.Component.OnPingDocument().ScheduleSolution(1, lambda: ghenv.Component.ExpireSolution(False))
    for i, output_name in enumerate(output_list):
        ghenv.Component.Params.Output[output_index].AddVolatileData(ghData.GH_Path(0), i, output_name)


# Erase Outputs
def erase_outputs():
    for i in range(ghenv.Component.Params.Output.Count-1, -1, -1):
        ghenv.Component.Params.UnregisterOutputParameter(ghenv.Component.Params.Output[i])
    ghenv.Component.Params.OnParametersChanged()
    ghenv.Component.Attributes.PerformLayout()

# Use the functions
if on:
    data = read_json_file(locFile)
    output_dict = {}
    for entry in data.values():
        collect_data(entry, output_dict)
    create_outputs(output_dict)
else:
    erase_outputs()
# ---------- end givemethatjson_please ----------
panel = Panel(givemethatjson_please.location)
hours_close_hours = EFDataDescription(givemethatjson_please.hours_close_hours)
hours_opening_days = EFDataDescription(givemethatjson_please.hours_opening_days)
hours_start_hours = EFDataDescription(givemethatjson_please.hours_start_hours)
hours_time_window = EFDataDescription(givemethatjson_please.hours_time_window)
lat = EFDataDescription(givemethatjson_please.lat)
lng = EFDataDescription(givemethatjson_please.lng)
search = EFDataDescription(givemethatjson_please.search)
path_4 = FilePath("C:\Users\evallina\Dropbox\_eMiniProjects\210124_eRoutes\_urbanlensesRepos\urbanlenses\ul_GSP\_meerkat\Building_Outlines_2015.prj")
lat_long_to_point = LatLongToPoint(Latitude=lat, Longitude=lng, ProjectionFile=path_4)
transform_3 = Transform(move.Transform)
transform_4 = Transform(Geometry=lat_long_to_point, Transform=transform_3)
hours_opening_days_2 = EFDataDescription(hours_opening_days)
hours_time_window_2 = EFDataDescription(hours_time_window)
hours_close_hours_2 = EFDataDescription(hours_close_hours)
hours_start_hours_2 = EFDataDescription(hours_start_hours)
places_locations = EFDataDescription(transform_4)
search_2 = EFDataDescription(search)
swatch = EFDataDescription(ColourSwatch(SwatchColor=RGBA(255, 0, 0, 110)))

# ----
time_of_the_day = Slider(23, range=0..23)
day_of_the_week = ValueList({"Sunday": 0, "Monday": 1, "Tuesday": 2, "Wednesday": 3, "Thursday": 4, "Friday": 5, "Saturday": 6}, selected="Friday")
day_of_the_week_2 = EFDataDescription(day_of_the_week)
time_of_the_day_2 = EFDataDescription(time_of_the_day)
python = GhPythonScript(day=day_of_the_week_2, time=time_of_the_day_2)  # -> out, dayText, timeText; inputs day: Int32, time: Int32
# ---------- python: Python ----------
__author__ = "evallina"
__version__ = "2023.06.01"

import rhinoscriptsyntax as rs

import datetime

# Define the input parameters
day = int(day)
time = int(time)

# Convert the day integer to day name
day_names = [ 'Sunday', 'Monday', 'Tuesday', 'Wednesday', 'Thursday', 'Friday', 'Saturday']
dayText = day_names[day]

# Format the time as "hh:mm"
timeText = datetime.time(time).strftime("%H:%M")

# Output the results
dayText, timeText
# ---------- end python ----------
pt = ConstructPoint(XCoordinate=Slider(22, range=0..300), YCoordinate=Slider(46, range=0..300), ZCoordinate=0)
pt_2 = ConstructPoint(XCoordinate=Slider(22, range=0..300), YCoordinate=Slider(66, range=0..300), ZCoordinate=0)
texttoscreen = RenderTextToScreen(Text=python.dayText, Location=pt, Size=20, Color=RGB(255, 255, 255), Font="Arial", m_scWithvp=False)
texttoscreen_2 = RenderTextToScreen(Text=python.timeText, Location=pt_2, Size=10, Color=RGB(255, 255, 255), Font="Arial", m_scWithvp=False)
day_of_the_week_3 = EFDataDescription(day_of_the_week_2)
dom = ConstructDomain(DomainStart=0, DomainEnd=24)
dom_2 = ConstructDomain(DomainStart=Slider(50, range=50..250), DomainEnd=Slider(309, range=50..450))
time_of_the_day_3 = EFDataDescription(time_of_the_day_2)
panel_2 = Panel("""30
15""")
swatch_2 = ColourSwatch(SwatchColor=RGB(129, 140, 0))
dom_3 = ConstructDomain(DomainStart=Slider(215, range=1..800), DomainEnd=Slider(630, range=1..800))
Z = UnitZ(Factor=1)
number_slider = Slider(425, range=1..500)

# ---- group: JSON INPUT
path_5 = FilePath("C:\Loc2Route\230602_locations\20230602_195344_locations_Bars-Pub-breweries_150m.json")
givemethatjson_please_2 = GhPythonScript(locFile=path_5, on=Toggle(True))  # -> address, hours_close_hours, hours_opening_days, hours_start_hours, hours_time_window, icon, lat, lng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; inputs on: Boolean; same code as givemethatjson_please
hours_close_hours_3 = EFDataDescription(givemethatjson_please_2.hours_close_hours)
hours_opening_days_3 = EFDataDescription(givemethatjson_please_2.hours_opening_days)
hours_start_hours_3 = EFDataDescription(givemethatjson_please_2.hours_start_hours)
hours_time_window_3 = EFDataDescription(givemethatjson_please_2.hours_time_window)
lat_2 = EFDataDescription(givemethatjson_please_2.lat)
lng_2 = EFDataDescription(givemethatjson_please_2.lng)
search_3 = EFDataDescription(givemethatjson_please_2.search)
hours_opening_days_4 = EFDataDescription(hours_opening_days_3)
hours_time_window_4 = EFDataDescription(hours_time_window_3)
hours_close_hours_4 = EFDataDescription(hours_close_hours_3)
hours_start_hours_4 = EFDataDescription(hours_start_hours_3)
search_4 = EFDataDescription(search_3)
swatch_3 = EFDataDescription(ColourSwatch(SwatchColor=RGBA(168, 68, 199, 70)))

# ---- group: JSON INPUT / Let's put this GeoCoord in their right place
path_6 = FilePath("C:\Users\evallina\Dropbox\_eMiniProjects\210124_eRoutes\_urbanlensesRepos\urbanlenses\ul_GSP\_meerkat\Building_Outlines_2015.prj")
lat_long_to_point_2 = LatLongToPoint(Latitude=lat_2, Longitude=lng_2, ProjectionFile=path_6)
transform_5 = Transform(move.Transform)
transform_6 = Transform(Geometry=lat_long_to_point_2, Transform=transform_5)

# ---- group: JSON INPUT (continued)
places_locations_2 = EFDataDescription(transform_6)

# ----
panel_3 = Panel(hours_start_hours_4)

# ---- group: JSON INPUT
path_7 = FilePath("C:\Loc2Route\230603_locations\20230603_003141_locations_shopping-retail-store_300m.json")
givemethatjson_please_3 = GhPythonScript(locFile=path_7, on=Toggle(True))  # -> address, hours, hours_close_hours, hours_opening_days, hours_start_hours, hours_time_window, icon, lat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; inputs on: Boolean; same code as givemethatjson_please
lat_3 = EFDataDescription(givemethatjson_please_3.lat)
search_5 = EFDataDescription(givemethatjson_please_3.search)
hours_close_hours_5 = EFDataDescription(givemethatjson_please_3.hours_close_hours)
hours_opening_days_5 = EFDataDescription(givemethatjson_please_3.hours_opening_days)
hours_start_hours_5 = EFDataDescription(givemethatjson_please_3.hours_start_hours)
hours_time_window_5 = EFDataDescription(givemethatjson_please_3.hours_time_window)
lng_3 = EFDataDescription(givemethatjson_please_3.lng)
hours_opening_days_6 = EFDataDescription(hours_opening_days_5)
hours_time_window_6 = EFDataDescription(hours_time_window_5)
hours_close_hours_6 = EFDataDescription(hours_close_hours_5)
hours_start_hours_6 = EFDataDescription(hours_start_hours_5)
search_6 = EFDataDescription(search_5)
swatch_4 = EFDataDescription(ColourSwatch(SwatchColor=RGBA(53, 219, 208, 37)))

# ---- group: JSON INPUT / Let's put this GeoCoord in their right place
path_8 = FilePath("C:\Users\evallina\Dropbox\_eMiniProjects\210124_eRoutes\_urbanlensesRepos\urbanlenses\ul_GSP\_meerkat\Building_Outlines_2015.prj")
lat_long_to_point_3 = LatLongToPoint(Latitude=lat_3, Longitude=lng_3, ProjectionFile=path_8)
transform_7 = Transform(move.Transform)
transform_8 = Transform(Geometry=lat_long_to_point_3, Transform=transform_7)

# ---- group: JSON INPUT (continued)
places_locations_3 = EFDataDescription(transform_8)

# ---- group: Close_Hours
entwine = Entwine(Branch0X=hours_close_hours_2, Branch1X=hours_close_hours_4, Branch2X=hours_close_hours_6, FlattenInputs=False)

# ---- group: Opening Days
entwine_2 = Entwine(Branch0X=hours_opening_days_2, Branch1X=hours_opening_days_4, Branch2X=hours_opening_days_6, FlattenInputs=False)

# ---- group: Start_Hours
entwine_3 = Entwine(Branch0X=hours_start_hours_2, Branch1X=hours_start_hours_4, Branch2X=hours_start_hours_6, FlattenInputs=False)

# ---- group: Time_Window
entwine_4 = Entwine(Branch0X=hours_time_window_2, Branch1X=hours_time_window_4, Branch2X=hours_time_window_6, FlattenInputs=False)

# ---- group: Places Locations
entwine_5 = Entwine(Branch0X=places_locations, Branch1X=places_locations_2, Branch2X=places_locations_3, FlattenInputs=False)

# ---- group: Search
entwine_6 = Entwine(Branch0X=search_2, Branch1X=search_4, Branch2X=search_6, FlattenInputs=False)

# ---- group: colorSwatch
entwine_7 = Entwine(Branch0X=swatch, Branch1X=swatch_3, Branch2X=swatch_4, FlattenInputs=False)

# ----
comb_swatch = EFDataDescription(entwine_7)
pshift = ShiftPaths(Data=entwine_6, Offset=-1)
lng_4 = ListLength(List=pshift)
dup = DuplicateData(Data=comb_swatch, Number=lng_4, Order=True)  # -> graft(Data)
comb_opening_days = EFDataDescription(entwine_2)
comb_time_window = EFDataDescription(entwine_4)
comb_close_hours = EFDataDescription(entwine)
comb_start_hours = EFDataDescription(entwine_3)
comb_swatch_2 = EFDataDescription(simplify(dup))
comb_locations = EFDataDescription(entwine_5)
comb_search = EFDataDescription(entwine_6)
item = ListItem(List=comb_opening_days, Index=day_of_the_week_3, Wrap=True)
comb_locations_2 = EFDataDescription(comb_locations)
comb_locations_3 = EFDataDescription(comb_locations)
comb_time_window_2 = EFDataDescription(comb_time_window)
comb_close_hours_2 = EFDataDescription(comb_close_hours)
comb_start_hours_2 = EFDataDescription(comb_start_hours)
comb_locations_4 = EFDataDescription(comb_locations)
comb_swatch_3 = EFDataDescription(comb_swatch_2)
comb_search_2 = EFDataDescription(comb_search)
dispatch = Dispatch(List=comb_swatch_3, DispatchPattern=item)  # -> ListA, ListB
item_2 = ListItem(List=comb_start_hours_2, Index=day_of_the_week_3, Wrap=True)
item_3 = ListItem(List=comb_close_hours_2, Index=day_of_the_week_3, Wrap=True)
item_4 = ListItem(List=comb_time_window_2, Index=day_of_the_week_3, Wrap=True)
dispatch_2 = Dispatch(List=comb_locations_4, DispatchPattern=item)  # -> ListA, ListB
item_5 = ListItem(List=comb_search_2, Index=day_of_the_week_3, Wrap=True)
sel_com_swatch = EFDataDescription(dispatch.ListA)
sel_time_window = EFDataDescription(item_4)
sel_comb_search = EFDataDescription(item_5)
sel_comb_locations = EFDataDescription(dispatch_2.ListA)
sel_open_hours = EFDataDescription(item_2)
sel_close_hours = EFDataDescription(item_3)
python_2 = GhPythonScript(open_time=sel_open_hours, close_time=sel_close_hours)  # -> out, a; inputs open_time: Int32, close_time: Int32
# ---------- python_2: Python ----------
__author__ = "evallina"
__version__ = "2023.06.01"

import rhinoscriptsyntax as rs

dayTimesList=[]

for i in range(23):
    if open_time<= i <=close_time:
        dayTimesList.append(True)
    else:
        dayTimesList.append(False)
        
a=dayTimesList
# ---------- end python_2 ----------
comb_locations_5 = EFDataDescription(comb_locations_2)
remap = RemapNumbers(Value=sel_time_window, Source=dom, Target=dom_2)  # -> Mapped, Clipped
cir = Circle(Plane=sel_comb_locations, Radius=20)
mapped = EFDataDescription(remap.Mapped)
screentext = ScreenOrientedText(
    Text=sel_comb_search,
    Justification=5,
    Location=sel_comb_locations,
    SizeFactor=Slider(8, range=1..50),
    Depth=0,
    Absolute=False)
item_6 = ListItem(List=python_2.a, Index=time_of_the_day_3, Wrap=True)  # -> simplify(Item)
cir_2 = Circle(Plane=comb_locations_5, Radius=mapped)
dispatch_3 = Dispatch(List=sel_com_swatch, DispatchPattern=item_6)  # -> ListA, ListB
dispatch_4 = Dispatch(List=sel_comb_locations, DispatchPattern=item_6)  # -> ListA, ListB
dispatch_5 = Dispatch(List=mapped, DispatchPattern=item_6)  # -> ListA, ListB
dash = DashPattern(Curve=cir_2, Pattern=panel_2)  # -> Dashes, Gaps
sel_colorswatch = EFDataDescription(dispatch_3.ListA)
places_opened = EFDataDescription(dispatch_4.ListA)
sel_r = EFDataDescription(dispatch_5.ListA)
previewlw_2 = CustomPreviewLineweights(Geometry=dash.Dashes, Shader=ColourSwatch(SwatchColor=RGB(0, 191, 255)), Absolute=False)
cir_3 = Circle(Plane=places_opened, Radius=mapped)
comb_swatch_4 = EFDataDescription(comb_swatch_2)
srf = Surface(cir_3)
comb_swatch_5 = EFDataDescription(comb_swatch_2)

# ---- group: Opened Place at that Time
srf_2 = Surface(cir)
preview = CustomPreview(Geometry=srf_2, Material=comb_swatch_5)

# ----
preview_2 = CustomPreview(Geometry=srf, Material=comb_swatch_4)
places_opened_2 = EFDataDescription(places_opened)

# ---- group: Create Grid of Points for Gradient Map
comb_locations_6 = EFDataDescription(comb_locations_3)
comb_locations_7 = EFDataDescription(flatten(comb_locations_6))
cornersarea = GhPythonScript(x=comb_locations_7)  # -> out, a; inputs x: list of Point3d
# ---------- cornersarea: Python ----------
__author__ = "evallina"
__version__ = "2023.06.01"

import rhinoscriptsyntax as rs
import Rhino.Geometry as rg

# Check if the input list is not empty
if x:
    # Get the minimum and maximum points based on x and y coordinates
    min_point = rg.Point3d(min(x, key=lambda point: point.X).X, max(x, key=lambda point: point.Y).Y, 0)
    max_point = rg.Point3d(max(x, key=lambda point: point.X).X, min(x, key=lambda point: point.Y).Y, 0)
else:
    # If the input list is empty, set the default points
    min_point = rg.Point3d(0, 0, 0)
    max_point = rg.Point3d(0, 0, 0)

# Output the minimum and maximum points
a=[max_point, min_point ]
# ---------- end cornersarea ----------
item_7 = ListItem(List=cornersarea.a, Index=0, Wrap=True)  # -> Item, Item1
rec_2pt = Rectangle2Pt(Plane=PlaneXY(0, 0, 0), PointA=item_7.Item, PointB=item_7.Item1, Radius=0)  # -> Rectangle, Length
number_slider_2 = Slider(25, range=10..60)
offset = OffsetCurve(Curve=rec_2pt.Rectangle, Distance=1000, Corners=1)
sdivide = DivideSurface(Surface=offset, UCount=number_slider_2, VCount=number_slider_2)  # -> Points, Normals, Parameters
points_grid = EFDataDescription(sdivide.Points)

comb_locations_8 = EFDataDescription(comb_locations_3)
comb_locations_9 = EFDataDescription(flatten(comb_locations_8))
cornersarea_2 = GhPythonScript(x=comb_locations_9)  # -> out, a; inputs x: list of Point3d; same code as cornersarea
item_8 = ListItem(List=cornersarea_2.a, Index=0, Wrap=True)  # -> Item, Item1
rec_2pt_2 = Rectangle2Pt(Plane=PlaneXY(0, 0, 0), PointA=item_8.Item, PointB=item_8.Item1, Radius=0)  # -> Rectangle, Length
number_slider_3 = Slider(25, range=10..60)
offset_2 = OffsetCurve(Curve=rec_2pt_2.Rectangle, Distance=1000, Corners=1)
sdivide_2 = DivideSurface(Surface=offset_2, UCount=number_slider_3, VCount=number_slider_3)  # -> Points, Normals, Parameters
points_grid_2 = EFDataDescription(sdivide_2.Points)

# ----
lng_5 = ListLength(List=flatten(points_grid_2))
dup_2 = DuplicateData(Data=ColourSwatch(SwatchColor=RGB(3, 29, 48)), Number=lng_5, Order=True)

# ---- group: Gradient Map
places_opened_3 = EFDataDescription(flatten(places_opened_2))
points_grid_3 = EFDataDescription(flatten(points_grid))
pull = PullPoint(Point=points_grid_3, Geometry=places_opened_3, ClosestOnly=True)  # -> ClosestPoint, Distance
number_slider_4 = Slider(0, range=0..100)
number_slider_5 = Slider(100, range=0..100)
points_grid_4 = EFDataDescription(points_grid_3)
bnd = Bounds(Numbers=pull.Distance)
dom_4 = ConstructDomain(DomainStart=number_slider_4, DomainEnd=number_slider_5)
remap_2 = RemapNumbers(Value=expr("x*5", pull.Distance), Source=bnd, Target=dom_4)  # -> Mapped, Clipped
gradient = Gradient(
    LowerLimit=number_slider_4,
    UpperLimit=number_slider_5,
    Parameter=remap_2.Mapped,
    stops=[0: RGB(220, 0, 40), 1: RGB(0, 37, 61)])
del = DelaunayMesh(Points=points_grid_4, Plane=PlaneXY(0, 0, 0))
mcol = MeshColours(Mesh=del, Colours=gradient)  # disabled

# ----
grid_swatch = EFDataDescription(flatten(dup_2))

# ---- group: Gradient Map
places_opened_4 = EFDataDescription(flatten(places_opened_2))
points_grid_5 = EFDataDescription(flatten(points_grid_2))
points_grid_6 = EFDataDescription(points_grid_5)

# ----
sel_r_2 = EFDataDescription(flatten(sel_r))
sel_colorswatch_2 = EFDataDescription(flatten(sel_colorswatch))
round = Round(Number=sel_r_2)  # -> Nearest, Floor, Ceiling
bnd_2 = Bounds(Numbers=round.Nearest)
remap_3 = RemapNumbers(Value=round.Nearest, Source=bnd_2, Target=dom_3)  # -> Mapped, Clipped
move_2 = Move(Geometry=places_opened_4, Motion=Z)  # -> Geometry, Transform
cloud = CloudDisplay(Points=graft(move_2.Geometry), Colours=graft(sel_colorswatch_2), Size=graft(remap_3.Mapped), SpriteType=0)
