# Grasshopper definition ul_JsonHandling.gh (Grasshopper 1.0.7)
# plug-ins: MeerkatGIS

path = FilePath("C:\Loc2Route\230525_locations\20230525_135710_locations_Coffee_150m.json")
file = ReadFile(PerLineParse=True)  # -> C
#   port F: Uri of file to read
# ---------- file: VB line parser ----------
    action = GH_LineParserAction.Include
    Return line

    'Parse the line and return some data that represents the line.
    'If the line cannot be parsed, you can return Nothing and
    'assign a different action.
    'The default implementation is to just return the line itself.
    'If you return types that implement IGH_Goo, this component
    'will work substantially faster.
# ---------- end file ----------
python = GhPythonScript(x=path)  # -> out, a, simplify(b)
# ---------- python: Python ----------
__author__ = "evallina"
__version__ = "2023.05.25"

import rhinoscriptsyntax as rs


import json
import Rhino
import ghpythonlib.treehelpers as th

# Read the JSON data
with open(x, 'r') as file:  # 'x' corresponds to the file path input
    data = json.load(file)

keys = []
values = {}

# Get the first data entry keys
first_entry = next(iter(data.values()))
keys = list(first_entry.keys())

# Initialize values with empty lists for each key
for key in keys:
    values[key] = []

# Iterate over the items in the data
for _, value in data.items():
    for sub_key, sub_value in value.items():
        values[sub_key].append(sub_value)

# Convert values to a data tree, with each branch corresponding to a key
b = th.list_to_tree(list(values.values()))

# Output the keys and values
a = keys
# ---------- end python ----------
panel = Panel(python.a)
panel_2 = Panel(python.b)
lat_long_to_point = LatLongToPoint()
