# Grasshopper definition ul_shortestpath.gh (Grasshopper 1.0.7)
# plug-ins: Human, EleFront

geo = Geometry([<curve referenced from the Rhino model> x3])
pt_or = Point(<point referenced from the Rhino model>)
pt_dest = Point(<point referenced from the Rhino model>)
geo_2 = Geometry(<curve referenced from the Rhino model>)
geometry = EFDataDescription(geo)
crv = Curve(geo_2)
divide = DivideCurve(Curve=crv, Count=10, Kinks=True)  # -> Points, Tangents, Parameters
area = Area(Geometry=geometry)  # -> Area, Centroid
sort = SortList(Keys=area.Area, ValuesA=geometry)  # -> Keys, ValuesA
pdecon = Deconstruct(Point=divide.Points)  # -> XComponent, YComponent, ZComponent
rev = ReverseList(List=sort.ValuesA)
split = SplitList(List=rev, Index=1)  # -> ListA, ListB
sort_2 = SortList(Keys=pdecon.XComponent)  # -> Keys, ValuesA
sort_3 = SortList(Keys=pdecon.YComponent)  # -> Keys, ValuesA
big_curve = EFDataDescription(split.ListA)
inner_curves = EFDataDescription(split.ListB)
big_curve_2 = EFDataDescription(big_curve)
item = ListItem(List=sort_2.Keys, Index=-1, Wrap=True)
item_2 = ListItem(List=sort_2.Keys, Index=0, Wrap=True)
item_3 = ListItem(List=sort_3.Keys, Index=0, Wrap=True)
item_4 = ListItem(List=sort_3.Keys, Index=-1, Wrap=True)
rec_of_poly = RecOfPoly(C=big_curve_2)  # -> crv_rec_2, domain_2
number_slider = Slider(2, range=0..20)
pt = ConstructPoint(XCoordinate=item_2, YCoordinate=item_4, ZCoordinate=0)
pt_2 = ConstructPoint(XCoordinate=item, YCoordinate=item_3, ZCoordinate=0)
dedom2 = DeconstructDomain²(Domain=rec_of_poly.domain_2)  # -> UComponent, VComponent
geo_3 = Geometry(rec_of_poly.crv_rec_2)
number_slider_2 = Slider(21.7, range=0..520)
rec_2pt = Rectangle2Pt(Plane=PlaneXY(0, 0, 0), PointA=pt, PointB=pt_2, Radius=0)  # -> Rectangle, Length
srf = Surface(geo_3)
num = Number(dedom2.UComponent)
num_2 = Number(dedom2.VComponent)
geometry_2 = EFDataDescription(geometry)
bnd = Bounds2D(Coordinates=divide.Points)
number_slider_3 = Slider(20, range=10..100)
division = Division(A=num, B=number_slider)
division_2 = Division(A=num_2, B=number_slider)
divide_2 = DivideDomain²(Domain=bnd, UCount=number_slider_3, VCount=number_slider_3)
sdivide = DivideSurface(Surface=srf, UCount=division, VCount=division_2)  # -> flatten(Points), Normals, Parameters
subsrf = Isotrim(Surface=rec_2pt.Rectangle, Domain=divide_2)
big_curve_3 = EFDataDescription(big_curve)
edges = BrepEdges(Brep=subsrf)  # -> simplify(Naked), Interior, NonManifold
incurve = PointInCurve(Point=sdivide.Points, Curve=big_curve_3)  # -> Relationship, Point
larger = LargerThan(FirstNumber=incurve.Relationship, SecondNumber=1)  # -> LargerThan, OrEqualTo
end = EndPoints(Curve=edges.Naked)  # -> Start, End
pt_3 = Point(flatten([end.End, end.Start]))
dispatch = Dispatch(List=sdivide.Points, DispatchPattern=larger.LargerThan)  # -> ListA, ListB
cullpt = CullDuplicates(Points=pt_3, Tolerance=0.1, CullMode=3)  # -> Points, Indices, Valence
list_a = EFDataDescription(dispatch.ListA)
inner_curves_2 = EFDataDescription(inner_curves)
pt_4 = Point([<point referenced from the Rhino model> x53])
incurves = PointInCurves(Point=list_a, Curves=inner_curves_2)  # -> Relationship, Index, Point
larger_2 = LargerThan(FirstNumber=incurves.Relationship, SecondNumber=1)  # -> LargerThan, OrEqualTo
python = GhPythonScript(origin=pt_or, destination=pt_dest, crv=crv, pts=cullpt.Points)  # -> out, shortest_path, pts_inside; inputs origin: Point3d, destination: Point3d, crv: Curve, pts: list of Point3d
# ---------- python: Python ----------
__author__ = "evallina"
__version__ = "2023.05.27"

import Rhino.Geometry as rg
import rhinoscriptsyntax as rs

def GetPointsInsideCurve(crv, pts):
    pts_inside = []
    for pt in pts:
        if crv.Contains(pt) == rg.PointContainment.Inside:
            pts_inside.append(pt)
    return pts_inside

def IsValidLine(crv, line):
    intersection = rg.Intersect.Intersection.CurveCurve(crv, line.ToNurbsCurve(), 0.001, 0.001)
    if intersection.Count > 0:
        return False
    return True

def GetShortestPath(pts, start_pt, end_pt):
    # Convert GUIDs to Point3d
    start_pt = rs.coerce3dpoint(start_pt)
    end_pt = rs.coerce3dpoint(end_pt)
    pts = [rs.coerce3dpoint(pt) for pt in pts]

    # Check if start and end points are in pts, if not, add them.
    if start_pt not in pts:
        pts.append(start_pt)
    if end_pt not in pts:
        pts.append(end_pt)

    # Construct graph
    graph = {}
    for i in range(len(pts) - 1):
        for j in range(i + 1, len(pts)):
            line = rg.Line(pts[i], pts[j])
            if IsValidLine(crv, line):
                if i not in graph:
                    graph[i] = {}
                if j not in graph:
                    graph[j] = {}
                graph[i][j] = line.Length
                graph[j][i] = line.Length

    start_idx = pts.index(start_pt)
    end_idx = pts.index(end_pt)

    # Dijkstra's algorithm
    shortest_distances = {start_idx: (None, 0)}
    current_node = start_idx
    visited = set()

    while current_node != end_idx:
        visited.add(current_node)
        destinations = graph[current_node].items()

        weight_to_current_node = shortest_distances[current_node][1]

        for next_node, weight in destinations:
            if next_node not in visited:
                old_weight = shortest_distances.get(next_node, (None, float('inf')))[1]
                new_weight = weight_to_current_node + weight
                if new_weight < old_weight:
                    shortest_distances[next_node] = (current_node, new_weight)

        next_destinations = {node: shortest_distances[node] for node in shortest_distances if node not in visited}
        if not next_destinations:
            return []
        
        # next node is the destination with the lowest weight
        current_node = min(next_destinations, key=lambda k: next_destinations[k][1])

    # Work back through destinations in shortest path
    path = []
    while current_node is not None:
        path.append(current_node)
        next_node = shortest_distances[current_node][0]
        current_node = next_node

    # Reverse path
    path = path[::-1]

    # Convert the list of points to a polyline
    polyline_path = rg.Polyline([pts[i] for i in path])

    return polyline_path

# The inputs to this script will be:
# 'origin' - the starting point
# 'destination' - the ending point
# 'crv' - the closed polyline (open space)
# 'pts' - the cloud of points

pts_inside = GetPointsInsideCurve(crv, pts)
shortest_path = GetShortestPath(pts_inside, origin, destination)
# ---------- end python ----------
geometry_3 = EFDataDescription(geometry_2)
dispatch_2 = Dispatch(List=list_a, DispatchPattern=larger_2.LargerThan)  # -> ListA, ListB
points_inside = EFDataDescription(dispatch_2.ListB)
pline = PolyLine(Vertices=python.shortest_path, Closed=False)
python_2 = GhPythonScript(origin=pt_or, destination=pt_dest, crvs=geometry_3, pts=cullpt.Points)  # -> out, shortest_path; inputs origin: Point3d, destination: Point3d, crvs: list of Curve, pts: list of Point3d
# ---------- python_2: Python ----------
__author__ = "evallina"
__version__ = "2023.05.27"

import Rhino.Geometry as rg
import rhinoscriptsyntax as rs

def IsValidLine(crvs, line):
    for crv in crvs:
        intersection = rg.Intersect.Intersection.CurveCurve(crv, line.ToNurbsCurve(), 0.001, 0.001)
        if intersection.Count > 0:
            return False
    return True

def GetShortestPath(pts, start_pt, end_pt, crvs):
    # Convert GUIDs to Point3d
    start_pt = rs.coerce3dpoint(start_pt)
    end_pt = rs.coerce3dpoint(end_pt)
    pts = [rs.coerce3dpoint(pt) for pt in pts]

    # Check if start and end points are in pts, if not, add them.
    if start_pt not in pts:
        pts.append(start_pt)
    if end_pt not in pts:
        pts.append(end_pt)

    # Construct graph
    graph = {}
    for i in range(len(pts) - 1):
        for j in range(i + 1, len(pts)):
            line = rg.Line(pts[i], pts[j])
            if IsValidLine(crvs, line):
                if i not in graph:
                    graph[i] = {}
                if j not in graph:
                    graph[j] = {}
                graph[i][j] = line.Length
                graph[j][i] = line.Length

    start_idx = pts.index(start_pt)
    end_idx = pts.index(end_pt)

    # Dijkstra's algorithm
    shortest_distances = {start_idx: (None, 0)}
    current_node = start_idx
    visited = set()

    while current_node != end_idx:
        visited.add(current_node)
        destinations = graph[current_node].items()

        weight_to_current_node = shortest_distances[current_node][1]

        for next_node, weight in destinations:
            if next_node not in visited:
                old_weight = shortest_distances.get(next_node, (None, float('inf')))[1]
                new_weight = weight_to_current_node + weight
                if new_weight < old_weight:
                    shortest_distances[next_node] = (current_node, new_weight)

        next_destinations = {node: shortest_distances[node] for node in shortest_distances if node not in visited}
        if not next_destinations:
            return []
        
        # next node is the destination with the lowest weight
        current_node = min(next_destinations, key=lambda k: next_destinations[k][1])

    # Work back through destinations in shortest path
    path = []
    while current_node is not None:
        path.append(current_node)
        next_node = shortest_distances[current_node][0]
        current_node = next_node

    # Reverse path
    path = path[::-1]

    # Convert the list of points to a polyline
    polyline_path = rg.Polyline([pts[i] for i in path])

    return polyline_path

# The inputs to this script will be:
# 'origin' - the starting point
# 'destination' - the ending point
# 'crvs' - the list of curves
# 'pts' - the cloud of points

shortest_path = GetShortestPath(pts, origin, destination, crvs)
# ---------- end python_2 ----------
python_3 = GhPythonScript(origin=pt_or, destination=pt_dest, crvs=geometry_3, pts=points_inside)  # -> out, shortest_path; inputs origin: Point3d, destination: Point3d, crvs: list of Curve, pts: list of Point3d
# ---------- python_3: Python ----------
__author__ = "evallina"
__version__ = "2023.05.27"

import Rhino.Geometry as rg
import rhinoscriptsyntax as rs

def IsValidLine(crvs, line):
    for crv in crvs:
        intersection = rg.Intersect.Intersection.CurveCurve(crv, line.ToNurbsCurve(), 0.001, 0.001)
        if intersection.Count > 0:
            return False
    return True

def GetAdditionalPoints(crvs, num_points):
    additional_pts = []
    for crv in crvs:
        t_vals = crv.DivideByCount(num_points, True)
        if t_vals: 
            for t in t_vals:
                pt = crv.PointAt(t)
                additional_pts.append(pt)
    return additional_pts

def GetShortestPath(pts, start_pt, end_pt, crvs):
    # Convert GUIDs to Point3d
    start_pt = rs.coerce3dpoint(start_pt)
    end_pt = rs.coerce3dpoint(end_pt)
    pts = [rs.coerce3dpoint(pt) for pt in pts]

    # Get additional points along the boundary curves
    additional_pts = GetAdditionalPoints(crvs, 10) # Number of points per curve can be adjusted
    pts += additional_pts

    # Check if start and end points are in pts, if not, add them.
    if start_pt not in pts:
        pts.append(start_pt)
    if end_pt not in pts:
        pts.append(end_pt)

    # Construct graph
    graph = {}
    for i in range(len(pts) - 1):
        for j in range(i + 1, len(pts)):
            line = rg.Line(pts[i], pts[j])
            if IsValidLine(crvs, line):
                if i not in graph:
                    graph[i] = {}
                if j not in graph:
                    graph[j] = {}
                graph[i][j] = line.Length
                graph[j][i] = line.Length

    start_idx = pts.index(start_pt)
    end_idx = pts.index(end_pt)

    # Dijkstra's algorithm
    shortest_distances = {start_idx: (None, 0)}
    current_node = start_idx
    visited = set()

    while current_node != end_idx:
        visited.add(current_node)
        destinations = graph[current_node].items()

        weight_to_current_node = shortest_distances[current_node][1]

        for next_node, weight in destinations:
            if next_node not in visited:
                old_weight = shortest_distances.get(next_node, (None, float('inf')))[1]
                new_weight = weight_to_current_node + weight
                if new_weight < old_weight:
                    shortest_distances[next_node] = (current_node, new_weight)

        next_destinations = {node: shortest_distances[node] for node in shortest_distances if node not in visited}
        if not next_destinations:
            return []
        
        # next node is the destination with the lowest weight
        current_node = min(next_destinations, key=lambda k: next_destinations[k][1])

    # Work back through destinations in shortest path
    path = []
    while current_node is not None:
        path.append(current_node)
        next_node = shortest_distances[current_node][0]
        current_node = next_node

    # Reverse path
    path = path[::-1]

    # Convert the list of points to a polyline
    polyline_path = rg.Polyline([pts[i] for i in path])

    return polyline_path

# The inputs to this script will be:
# 'origin' - the starting point
# 'destination' - the ending point
# 'crvs' - the list of curves
# 'pts' - the cloud of points

shortest_path = GetShortestPath(pts, origin, destination, crvs)
# ---------- end python_3 ----------
previewlw = CustomPreviewLineweights(Geometry=pline, Shader=ColourSwatch(SwatchColor=RGB(255, 255, 255)), Thickness=Slider(4, range=1..10), Absolute=False)
pline_2 = PolyLine(Vertices=python_3.shortest_path, Closed=False)
previewlw_2 = CustomPreviewLineweights(Geometry=pline_2, Shader=ColourSwatch(SwatchColor=RGB(255, 255, 255)), Thickness=Slider(4, range=1..10), Absolute=False)

# ==== cluster RecOfPoly
C = ClusterInput()
divide = DivideCurve(Curve=C, Count=10, Kinks=True)  # -> Points, Tangents, Parameters
pdecon = Deconstruct(Point=divide.Points)  # -> XComponent, YComponent, ZComponent
sort = SortList(Keys=pdecon.XComponent)  # -> Keys, ValuesA
sort_2 = SortList(Keys=pdecon.YComponent)  # -> Keys, ValuesA
number_slider = Slider(2.3, range=-5..5)
item = ListItem(List=sort.Keys, Index=-1, Wrap=True)
item_2 = ListItem(List=sort.Keys, Index=0, Wrap=True)
item_3 = ListItem(List=sort_2.Keys, Index=0, Wrap=True)
item_4 = ListItem(List=sort_2.Keys, Index=-1, Wrap=True)
multiplication = Multiplication(A=number_slider, B=-1)
pt = ConstructPoint(XCoordinate=item_2, YCoordinate=item_4, ZCoordinate=0)
pt_2 = ConstructPoint(XCoordinate=item, YCoordinate=item_3, ZCoordinate=0)
entwine = Entwine(Branch00=number_slider, Branch01=multiplication, FlattenInputs=True)  # -> flatten(Result)
rec_2pt = Rectangle2Pt(Plane=PlaneXY(0, 0, 0), PointA=pt, PointB=pt_2, Radius=0)  # -> Rectangle, Length
offset = OffsetCurve(Curve=rec_2pt.Rectangle, Distance=entwine, Corners=1)  # -> simplify(flatten(Curve))
area = Area(Geometry=flatten(offset))  # -> flatten(Area), Centroid
sort_3 = SortList(Keys=area.Area, ValuesA=offset)  # -> Keys, ValuesA
rev = ReverseList(List=sort_3.ValuesA)
item_5 = ListItem(List=rev, Index=0, Wrap=True)
crv_rec = EFDataDescription(item_5)
divide_2 = DivideCurve(Curve=crv_rec, Count=1, Kinks=True)  # -> Points, Tangents, Parameters
bnd = Bounds2D(Coordinates=divide_2.Points)
domain = EFDataDescription(bnd)
crv_rec_2 = ClusterOutput(crv_rec)
domain_2 = ClusterOutput(domain)
