# Grasshopper definition ul_shortestpath2.gh (Grasshopper 1.0.7)
# plug-ins: EleFront, Human, MeerkatGIS

pt_dest = Point(<point referenced from the Rhino model>)
geo = Geometry(<curve referenced from the Rhino model>)
geo_2 = Geometry([<curve referenced from the Rhino model> x3])
pt_or = Point(<point referenced from the Rhino model>)
geometry = EFDataDescription(geo_2)
crv = Curve(geo)
path = FilePath("C:\Loc2Route\230526_routes\20230526_093631_finalDataRoute_Route_Coffee_walking.json")
area = Area(Geometry=geometry)  # -> Area, Centroid
path_2 = FilePath("C:\Users\evallina\Dropbox\_eMiniProjects\210124_eRoutes\_urbanlensesRepos3\urbanlenses\ul_GSP\_meerkat\bldg_outlines2.mkgis")
ul_routes = GhPythonScript(ul_routes_file=path)  # -> out, data_gral, totalDistance, totalDuration, travelMode, ElevationChange, ElevationAvgSlope, data_steps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
# ---------- ul_routes: Python ----------
__author__ = "evallina"
__version__ = "2023.05.29"

import rhinoscriptsyntax as rs

import json
import ghpythonlib.treehelpers as th

# load data from json file
with open(ul_routes_file) as json_file:
    data = json.load(json_file)

# Initialize lists to store all data
totalDistance = []
totalDuration = []
travelMode = []
ElevationChange = []
ElevationAvgSlope = []
steplDistance = []
stepDuration = []
stepStartPt = []
stepEndPt = []
stepElevation = []
stepElevSlopes = []

# Iterate over each entry in data
for key in data.keys():
    data_gral = data[key]["data_gral"]
    totalDistance.append([data_gral["totalDistance"]])
    totalDuration.append([data_gral["totalDuration"]])
    travelMode.append([data_gral["travelMode"]])
    ElevationChange.append([data_gral["ElevationChange"]])
    ElevationAvgSlope.append([data_gral["ElevationAvgSlope"]])

    data_steps = data[key]["data_steps"]
    steplDistance.append(data_steps["steplDistance"])
    stepDuration.append(data_steps["stepDuration"])
    stepStartPt.append(data_steps["stepStartPt"])
    stepEndPt.append(data_steps["stepEndPt"])
    stepElevation.append(data_steps["stepElevation"])
    stepElevSlopes.append(data_steps["stepElevSlopes"])

# Convert lists to datatrees
totalDistance = th.list_to_tree(totalDistance)
totalDuration = th.list_to_tree(totalDuration)
travelMode = th.list_to_tree(travelMode)
ElevationChange = th.list_to_tree(ElevationChange)
ElevationAvgSlope = th.list_to_tree(ElevationAvgSlope)
steplDistance = th.list_to_tree(steplDistance)
stepDuration = th.list_to_tree(stepDuration)
stepStartPt = th.list_to_tree(stepStartPt)
stepEndPt = th.list_to_tree(stepEndPt)
stepElevation = th.list_to_tree(stepElevation)
stepElevSlopes = th.list_to_tree(stepElevSlopes)
# ---------- end ul_routes ----------
sort = SortList(Keys=area.Area, ValuesA=geometry)  # -> Keys, ValuesA
rev = ReverseList(List=sort.ValuesA)
parse_mkgis = ParseMeerkatFile(MeerkatFile=path_2)  # -> DateCropped, UserAndMachineNamed, PathForFiles, ShapeType, ShapeCountInSource, BoundsInPointSpace, BoundsInLatLong, FieldNames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
split = SplitList(List=rev, Index=1)  # -> ListA, ListB
cluster = Cluster(coordinates=ul_routes.stepEndPt)
cluster_2 = Cluster(coordinates=ul_routes.stepStartPt)
big_curve = EFDataDescription(split.ListA)
stepelevation = EFDataDescription(ul_routes.stepElevation)
inner_curves = EFDataDescription(split.ListB)
geometry_per_shape = EFDataDescription(parse_mkgis.GeometryPerShape)
big_curve_2 = EFDataDescription(big_curve)
rec_of_poly = RecOfPoly(C=big_curve_2)  # -> crv_rec_2, domain_2
lng = ListLength(List=cluster)
number_slider = Slider(2, range=0..20)
dedom2 = DeconstructDomain²(Domain=rec_of_poly.domain_2)  # -> UComponent, VComponent
geo_3 = Geometry(rec_of_poly.crv_rec_2)
item = ListItem(List=cluster, Index=expr("x-1", lng), Wrap=True)
number_slider_2 = Slider(21.7, range=0..520)
srf = Surface(geo_3)
num = Number(dedom2.UComponent)
num_2 = Number(dedom2.VComponent)
geometry_2 = EFDataDescription(geometry)
ins = InsertItems(List=cluster_2, Item=item, Indices=expr("x-1", lng), Wrap=True)  # -> simplify(List)
division = Division(A=num, B=number_slider)
division_2 = Division(A=num_2, B=number_slider)
list = EFDataDescription(ins)
sdivide = DivideSurface(Surface=srf, UCount=division, VCount=division_2)  # -> flatten(Points), Normals, Parameters
big_curve_3 = EFDataDescription(big_curve)
item_2 = ListItem(List=list, Index=0, Wrap=True)
incurve = PointInCurve(Point=sdivide.Points, Curve=big_curve_3)  # -> Relationship, Point
stepelevation_2 = EFDataDescription(simplify(stepelevation))
vec2pt = Vector2Pt(PointA=item_2, PointB=<geometry referenced from the Rhino model>, Unitize=False)  # -> Vector, Length
larger = LargerThan(FirstNumber=incurve.Relationship, SecondNumber=1)  # -> LargerThan, OrEqualTo
rev_2 = ReverseList(List=stepelevation_2)
move = Move(Geometry=list, Motion=vec2pt.Vector)  # -> Geometry, Transform
transform = Transform(move.Transform)
transform_2 = Transform(Geometry=geometry_per_shape, Transform=transform)
pline = PolyLine(Vertices=transform_2, Closed=True)
geo_4 = Geometry(pline)
dispatch = Dispatch(List=sdivide.Points, DispatchPattern=larger.LargerThan)  # -> ListA, ListB
list_a = EFDataDescription(dispatch.ListA)
inner_curves_2 = EFDataDescription(inner_curves)
Z = UnitZ(Factor=rev_2)
pt_or_2 = Point(<point referenced from the Rhino model>)
pt_dest_2 = Point(<point referenced from the Rhino model>)
incurves = PointInCurves(Point=list_a, Curves=inner_curves_2)  # -> Relationship, Index, Point
larger_2 = LargerThan(FirstNumber=incurves.Relationship, SecondNumber=1)  # -> LargerThan, OrEqualTo
move_2 = Move(Geometry=move.Geometry, Motion=Z)  # -> Geometry, Transform
screentext = ScreenOrientedText(Text="O", Justification=7, Location=pt_or_2, SizeFactor=10, Depth=0, Absolute=False)
geometry_3 = EFDataDescription(geometry_2)
dispatch_2 = Dispatch(List=list_a, DispatchPattern=larger_2.LargerThan)  # -> ListA, ListB
screentext_2 = ScreenOrientedText(Text="D", Justification=7, Location=pt_dest_2, SizeFactor=10, Depth=0, Absolute=False)
pline_2 = PolyLine(Vertices=move_2.Geometry, Closed=False)
list_b = EFDataDescription(dispatch_2.ListB)
flatten = FlattenTree(Tree=move_2.Geometry, Path="{0}")
shortestpath = GhPythonScript(origin=pt_or, destination=pt_dest, crvs=geometry_3, pts=list_b)  # -> out, shortest_path; inputs origin: Point3d, destination: Point3d, crvs: list of Curve, pts: list of Point3d
# ---------- shortestpath: Python ----------
__author__ = "evallina"
__version__ = "2023.05.27"

import Rhino.Geometry as rg
import rhinoscriptsyntax as rs

def IsValidLine(crvs, line):
    for crv in crvs:
        intersection = rg.Intersect.Intersection.CurveCurve(crv, line.ToNurbsCurve(), 0.001, 0.001)
        if intersection.Count > 0:
            return False
    return True

def GetShortestPath(pts, start_pt, end_pt, crvs):
    # Convert GUIDs to Point3d
    start_pt = rs.coerce3dpoint(start_pt)
    end_pt = rs.coerce3dpoint(end_pt)
    pts = [rs.coerce3dpoint(pt) for pt in pts]

    # Check if start and end points are in pts, if not, add them.
    if start_pt not in pts:
        pts.append(start_pt)
    if end_pt not in pts:
        pts.append(end_pt)

    # Construct graph
    graph = {}
    for i in range(len(pts) - 1):
        for j in range(i + 1, len(pts)):
            line = rg.Line(pts[i], pts[j])
            if IsValidLine(crvs, line):
                if i not in graph:
                    graph[i] = {}
                if j not in graph:
                    graph[j] = {}
                graph[i][j] = line.Length
                graph[j][i] = line.Length

    start_idx = pts.index(start_pt)
    end_idx = pts.index(end_pt)

    # Dijkstra's algorithm
    shortest_distances = {start_idx: (None, 0)}
    current_node = start_idx
    visited = set()

    while current_node != end_idx:
        visited.add(current_node)
        destinations = graph[current_node].items()

        weight_to_current_node = shortest_distances[current_node][1]

        for next_node, weight in destinations:
            if next_node not in visited:
                old_weight = shortest_distances.get(next_node, (None, float('inf')))[1]
                new_weight = weight_to_current_node + weight
                if new_weight < old_weight:
                    shortest_distances[next_node] = (current_node, new_weight)

        next_destinations = {node: shortest_distances[node] for node in shortest_distances if node not in visited}
        if not next_destinations:
            return []
        
        # next node is the destination with the lowest weight
        current_node = min(next_destinations, key=lambda k: next_destinations[k][1])

    # Work back through destinations in shortest path
    path = []
    while current_node is not None:
        path.append(current_node)
        next_node = shortest_distances[current_node][0]
        current_node = next_node

    # Reverse path
    path = path[::-1]

    # Convert the list of points to a polyline
    polyline_path = rg.Polyline([pts[i] for i in path])

    return polyline_path

# The inputs to this script will be:
# 'origin' - the starting point
# 'destination' - the ending point
# 'crvs' - the list of curves
# 'pts' - the cloud of points

shortest_path = GetShortestPath(pts, origin, destination, crvs)
# ---------- end shortestpath ----------
shortestpath_2 = GhPythonScript(origin=pt_or_2, destination=pt_dest_2, pts=flatten)  # -> out, shortest_path; inputs origin: Point3d, destination: Point3d, crvs: list of Curve, pts: list of Point3d; same code as shortestpath
pline_3 = PolyLine(Vertices=shortestpath.shortest_path, Closed=False)
previewlw = CustomPreviewLineweights(Geometry=pline_3, Shader=ColourSwatch(SwatchColor=RGB(255, 255, 255)), Thickness=Slider(4, range=1..10), Absolute=False)
pline_4 = PolyLine(Vertices=shortestpath_2.shortest_path, Closed=False)
previewlw_2 = CustomPreviewLineweights(Geometry=pline_4, Shader=ColourSwatch(SwatchColor=RGB(235, 35, 35)), Thickness=Slider(4, range=1..10), Absolute=False)

# ==== cluster RecOfPoly
C = ClusterInput()
divide = DivideCurve(Curve=C, Count=10, Kinks=True)  # -> Points, Tangents, Parameters
pdecon = Deconstruct(Point=divide.Points)  # -> XComponent, YComponent, ZComponent
sort = SortList(Keys=pdecon.XComponent)  # -> Keys, ValuesA
sort_2 = SortList(Keys=pdecon.YComponent)  # -> Keys, ValuesA
number_slider = Slider(2.3, range=-5..5)
item = ListItem(List=sort.Keys, Index=-1, Wrap=True)
item_2 = ListItem(List=sort.Keys, Index=0, Wrap=True)
item_3 = ListItem(List=sort_2.Keys, Index=0, Wrap=True)
item_4 = ListItem(List=sort_2.Keys, Index=-1, Wrap=True)
multiplication = Multiplication(A=number_slider, B=-1)
pt = ConstructPoint(XCoordinate=item_2, YCoordinate=item_4, ZCoordinate=0)
pt_2 = ConstructPoint(XCoordinate=item, YCoordinate=item_3, ZCoordinate=0)
entwine = Entwine(Branch00=number_slider, Branch01=multiplication, FlattenInputs=True)  # -> flatten(Result)
rec_2pt = Rectangle2Pt(Plane=PlaneXY(0, 0, 0), PointA=pt, PointB=pt_2, Radius=0)  # -> Rectangle, Length
offset = OffsetCurve(Curve=rec_2pt.Rectangle, Distance=entwine, Corners=1)  # -> simplify(flatten(Curve))
area = Area(Geometry=flatten(offset))  # -> flatten(Area), Centroid
sort_3 = SortList(Keys=area.Area, ValuesA=offset)  # -> Keys, ValuesA
rev = ReverseList(List=sort_3.ValuesA)
item_5 = ListItem(List=rev, Index=0, Wrap=True)
crv_rec = EFDataDescription(item_5)
divide_2 = DivideCurve(Curve=crv_rec, Count=1, Kinks=True)  # -> Points, Tangents, Parameters
bnd = Bounds2D(Coordinates=divide_2.Points)
domain = EFDataDescription(bnd)
crv_rec_2 = ClusterOutput(crv_rec)
domain_2 = ClusterOutput(domain)

# ==== cluster Cluster
coordinates = ClusterInput()
python = GhPythonScript(coordinates=coordinates)  # -> out, longitude, latitude; inputs coordinates: list
# ---------- python: Python ----------
__author__ = "evallina"
__version__ = "2023.05.29"

import rhinoscriptsyntax as rs

# Define the input parameter coordinates
#coordinates = ["-122.3388801,47.60801499999999", "-122.3390791,47.6079298", "-122.3401281,47.608789"]

# Initialize empty lists for longitude and latitude
longitude = []
latitude = []

# For each coordinate in the list, split the string by comma and append to the respective list
for coord in coordinates:
    lon, lat = coord.split(',')
    longitude.append(float(lon))
    latitude.append(float(lat))
# ---------- end python ----------
path = FilePath("C:\Users\evallina\Dropbox\_eMiniProjects\210124_eRoutes\_urbanlensesRepos3\urbanlenses\_data\DATA\shp\Building_Outlines_2015\Building_Outlines_2015.prj")
lat_long_to_point = LatLongToPoint(Latitude=python.latitude, Longitude=python.longitude, ProjectionFile=path)
p = ClusterOutput(lat_long_to_point)
